# Grasshopper definition grasshopper_revised.gh (Grasshopper 1.0.8)
# plug-ins: gHowl

udp = UDPReceiver(Port=Slider(9001, range=0..10000), Pattern=0)  # -> Info, Data
panel = Panel(udp.Data)
split = TextSplit(Text=udp.Data, Separators=",")
num = Number(split)
number_slider = Slider(120, range=0..200)
multiplication = Multiplication(A=num, B=Slider(5, range=0..100))
Z = UnitZ(Factor=1)
amp = Amplitude(Vector=Z, Amplitude=multiplication)
sqgrid = Square(
    Plane=PlaneXY(0, 0, 0),
    Size=Slider(30, range=0..100),
    ExtentX=expr("x-1", number_slider),
    ExtentY=expr("x-1", Slider(90, range=0..100)))  # -> Cells, flatten(Points)
panel_2 = Panel(amp)
pt = Point(sqgrid.Points)
Z_2 = UnitZ(Factor=amp)
move = Move(Geometry=pt, Motion=Z_2)  # -> Geometry, Transform
srfgrid = SurfaceFromPoints(Points=move.Geometry, UCount=number_slider, Interpolate=False)
